# Grasshopper definition GHSolar_Test.gh (Grasshopper 0.9.76)
# plug-ins: GHSolar

# ---- group: Data reader
panel = Panel("C:\Users\wach\Desktop\SolarV2\DNI.txt")  # disabled
panel_2 = Panel("C:\Users\wach\Desktop\SolarV2\DHI.txt")  # disabled
panel_3 = Panel("C:\Users\wach\Desktop\SolarV2\SNOW.txt")  # disabled
readtxt = ReadText(Path=panel)  # disabled
readtxt_2 = ReadText(Path=panel_2)  # disabled
readtxt_3 = ReadText(Path=panel_3)  # disabled

# ---- group: albedos
panel_4 = Panel("C:\Users\wach\Desktop\SolarV2\albedosGlass.txt")  # disabled
readtxt_4 = ReadText(Path=panel_4)  # disabled

# ---- group: analysis surface
srf = Surface(<surface referenced from the Rhino model>)
mesh_uv = MeshSurface(Surface=srf, UCount=Slider(2, range=0..100), VCount=Slider(2, range=0..100), Overhang=True, Equalize=False)

# ----
data = Data([0, 0, 0, 0, 0, 0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])
data_2 = Data([0, 0, 0, 0, 0, 0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])
data_3 = Data([0, 0, 0, 0, 0, 0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])

# ---- group: obstacles
mesh = Mesh([<mesh referenced from the Rhino model> x5])

# ----
data_4 = Data([0.8, 0.8, 0.8, 0.8, 0.8, 0.8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])
panel_5 = Panel(data_4)
mesh_2 = Mesh([mesh_uv, mesh])
obstobj = ObstacleObject(Mesh=mesh_2, Albedo=panel_5, Reflection="1")

srf_2 = Surface(<surface referenced from the Rhino model>)

# ---- group: weather
panel_6 = Panel(data)
panel_7 = Panel(data_2)
panel_8 = Panel(data_3)

# ---- group: Latitude
panel_9 = Panel("47.367347")

# ---- group: Longitude
panel_10 = Panel("8.5500025")

# ----
toggle = BooleanToggle(True)
mesh_uv_2 = MeshSurface(Surface=srf_2, UCount="2", VCount="2", Overhang=True, Equalize=False)
item = ListItem(List=flatten(mesh_uv_2), Index=0, Wrap=True)
mesh_3 = Mesh(item)
irrmshy = IrradiationMeshYear(
    AnalysisMesh=mesh_uv,
    ObstacleObjects=obstobj,
    Latitude=panel_9,
    Longitude=panel_10,
    DNI=panel_8,
    DHI=panel_6,
    Snow=panel_7,
    Year="2013",
    SkydomeResolution="2",
    InterpolationMode="1",
    MT=toggle)  # disabled
matrix = Matrix()  # disabled

# ---- group: 8760 profiles foreach vertex
number_slider = Slider(75, range=0..120)  # disabled
c_script = CSharpScript(x=matrix, y=number_slider)  # -> out, A; inputs y: Int32; disabled
# ---------- c_script: C# ----------
//    Dim m As matrix
//    m = x
//
//    Dim test(m.ColumnCount - 1) As Double
//    Dim i As Integer
//    For i = 1 To m.ColumnCount - 1
//    test(i - 1) = m.item(y, i)
//    Next
//
//      A = test
    
    Matrix m = null;

    m = (Matrix) x;
    double [] test = new double[m.ColumnCount];
    for(int i = 0; i < m.ColumnCount; i++)
    {
      test[i] = m[y,i];
    }

    A = test;
# ---------- end c_script ----------
panel_11 = Panel(c_script.A)  # disabled

# ---- group: mesh visualization per hour of year
number_slider_2 = Slider(2508, range=0..8759)  # disabled
c_script_2 = CSharpScript(x=matrix, y=number_slider_2)  # -> out, A; inputs y: Int32; disabled
# ---------- c_script_2: C# ----------
    Matrix m = null;
    
    m = (Matrix)x;
    double [] test = new double[m.RowCount];
    for(int i = 0; i < m.RowCount; i++)
    {
      test[i] = m[i, y];
    }

    A = test;
# ---------- end c_script_2 ----------
panel_12 = Panel(c_script_2.A)  # disabled

# ----
irrmshh = IrradiationMeshhour(
    AnalysisMesh=mesh_uv,
    ObstacleObjects=obstobj,
    Latitude=panel_9,
    Longitude=panel_10,
    DNI=panel_8,
    DHI=panel_6,
    Snow=panel_7,
    Year="2013",
    Month=Slider(12, range=1..30),
    Day=Slider(2, range=1..12),
    Hour=Slider(10, range=0..23),
    Bounces="0",
    SkydomeResolution="2",
    MT=toggle)  # -> Vec, Results
number_slider_3 = Slider(0, range=0..7)
visumshsol = VisualizeMeshSolar(
    Mesh=mesh_uv,
    I=irrmshh.Results,
    Value=number_slider_3,
    Hour=Slider(731, range=0..8759),
    Min="110",
    Max="150",
    Clr=Slider(1, range=0..2))
readresults = ReadResults(Mesh=mesh_uv, I=irrmshh.Results, Value=number_slider_3, SP=Slider(0, range=0..8))  # -> Results, SP
panel_13 = Panel(readresults.Results)
