# Grasshopper definition sunpath_examle.gh (Grasshopper 1.0.7)
# plug-ins: GHSolar

panel = Panel([Slider(47.8, range=-90..90), Slider(24.331, range=-90..90)])
mesh = Mesh([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])
pt = Point(Point(1.070618619, -22.63256583, 0))
skydome = GHSkydome(
    RecursionLevel=Slider(3, range=0..5),
    Viewfactors=Toggle(False),
    CumSkyMatrix=Toggle(False),
    SunPath=Toggle(True),
    SolarVec=Toggle(False),
    HOY=Slider(2503, range=0..8759),
    Location=panel,
    Size=Slider(1, range=0..2),
    Context=mesh,
    Sp=pt)  # -> Mesh, Vectors, Sunpaths, SunGeo
